% Simulink data dictionary DD.sldd

sigInput = Simulink.Signal(StorageClass="ImportedExtern", DataType="Bus: inStruct")
sigOutput = Simulink.Signal(StorageClass="ExportedGlobal", DataType="Bus: outStruct")

outStruct = Simulink.Bus()
  enable: uint8
  step: uint8
  direction: uint8
  moveRange: int32
  enSave: uint8

inStruct = Simulink.Bus()
  timeStamp: uint32
  moveUp: uint8
  moveDown: uint8
  trig: uint8
  steps: uint32